# Grasshopper definition RhinoToUnity.gh (Grasshopper 1.0.7)
# plug-ins: Extensions

panel = Panel("C:\Users\vicen\Documents\Repositories\RhinoToUnity\Rhino files\export.xml")
panel_2 = Panel("""Lshape
Straight""")
unityexport = UnityExport(BlockNames=panel_2, InstancesLayer="Instances", Density="600*0.25", AngleLimit="0", BreakForce="400", FileName=panel)
